# Grasshopper definition plant_growth_sim.gh (Grasshopper 0.9.76)

c_script = CSharpScript(iterations=Slider(9, range=0..20))  # -> out, plant_output_state
# ---------- c_script: C# ----------
    List<float> xpos = (List<float>) xpositions;
    List<float> ypos = (List<float>) ypositions;
    List<int> pl_states = (List<int>) plant_states;
    List<int> pl_type = (List<int>) plant_type;
    int iters = Convert.ToInt32(iterations);
    List<float> pl_heights = (List<float>) plant_heights;
    List<float> pl_radius = (List<float>) plant_radius;
    List<float> pl_output_state = (List<float>) plant_output_state;

    simulation_plants = new List<Plant>();

    month = 0; //getting rid of warning, but will change with iterations

    for(int i = 0; i < xpos.Count; ++i)
    {
      switch (pl_type[i])
      {
        case (int) plant_enum.BEAR:
          simulation_plants.Add(new BearGrass(xpos[i], ypos[i], pl_states[i]));
          break;
        case (int) plant_enum.YUCCA:
          simulation_plants.Add(new Yucca(xpos[i], ypos[i], pl_states[i]));
          break;
        default:
          simulation_plants.Add(new LittleBluestem(xpos[i], ypos[i], pl_states[i]));
          break;
      }
    }

    plant_output_state = pl_output_state;
# ---------- c_script: C# additional code ----------
  private static int month;
  private static List<Plant> simulation_plants; // TODO change to quad tree

  public static int get_month()
  {
    return month;
  }

  enum month_enum
  {
    JAN,
    FEB,
    MAR,
    APR,
    MAY,
    JUN,
    JUL,
    AUG,
    SEP,
    OCT,
    NOV,
    DEC
  }
  enum state_enum
  {
    ALIVE,
    SEED,
    DEAD
  }
  enum color_rep_enum
  {
    WINTER,
    FLOWER,
    GREEN
  }
  enum sun_enum
  {
    SHADE,
    PARTIAL,
    FULL
  }
  enum plant_enum
  {
    BEAR,
    YUCCA,
    BLUESTEM
  }
  class Plant
  {
    protected float x, y, width_radius, height;
    public int state;
    protected const float min_radius = 99999;
    protected const sun_enum sun_requirements = sun_enum.FULL;

    public Plant(float x, float y, int state)
    {
      this.x = x;
      this.y = y;
      this.state = state;
      this.width_radius = 0;
      this.height = 0;
    }

    //getters

    //may vary per plant type
    public color_rep_enum get_color_rep(month_enum month)
    {
      switch (month)
      {
        case month_enum.JAN:
          return color_rep_enum.WINTER;
        case month_enum.FEB:
          return color_rep_enum.WINTER;
        case month_enum.MAR:
          return color_rep_enum.WINTER;
        case month_enum.APR:
          return color_rep_enum.GREEN;
        case month_enum.MAY:
          return color_rep_enum.FLOWER;
        case month_enum.JUN:
          return color_rep_enum.FLOWER;
        case month_enum.JUL:
          return color_rep_enum.FLOWER;
        case month_enum.AUG:
          return color_rep_enum.FLOWER;
        case month_enum.SEP:
          return color_rep_enum.GREEN;
        case month_enum.OCT:
          return color_rep_enum.GREEN;
        case month_enum.NOV:
          return color_rep_enum.WINTER;
        case month_enum.DEC:
          return color_rep_enum.WINTER;
      }
      return color_rep_enum.WINTER;
    }
    public float get_height()
    {
      return this.height;
    }

    public float get_width_radius()
    {
      return this.width_radius;
    }
  }
  class BearGrass : Plant
  {
    public BearGrass(float x, float y, int state) : base(x, y, state)
    {
    }
  }

  class LittleBluestem : Plant
  {
    public LittleBluestem(float x, float y, int state) : base(x, y, state)
    {
    }
  }

  class Yucca : Plant
  {
    public Yucca(float x, float y, int state) : base(x, y, state)
    {
    }
  }
# ---------- end c_script ----------
