# Grasshopper definition Project2GrasshopperSim_tests.gh (Grasshopper 0.9.76)

# ---- group: grid
slider = Slider(18, range=0..25)
sqgrid = Square(Plane=PlaneXY(0, 0, 0), Size=1, ExtentX=slider, ExtentY=slider)  # -> Cells, flatten(Points)

# ----
expression = Expression(p=sqgrid.Points, Expression="p.x")
expression_2 = Expression(p=sqgrid.Points, Expression="p.y")
pt = Point(sqgrid.Points)
lng = ListLength(List=pt)
panel = Panel(expression)
panel_2 = Panel(expression_2)
random = Random(Range="(0,2.999999)", Number=lng, Seed=Slider(3.3, range=0..5))
iterations = Slider(11, range=0..50)
expression_3 = Expression(x=random, Expression="int(x)")
random_2 = Random(Range="(0,1.999999)", Number=lng, Seed=Slider(3.3, range=0..5))
panel_3 = Panel(expression_3)
expression_4 = Expression(x=random_2, Expression="int(x)")
panel_4 = Panel(expression_4)
random_3 = Random(Range="(0,2.999999)", Number=lng, Seed=Slider(0.732, range=0..5))
expression_5 = Expression(x=random_3, Expression="int(x)")
panel_5 = Panel(expression_5)
c_script = CSharpScript(
    xpositions=expression,
    ypositions=expression_2,
    plant_states=expression_4,
    plant_type=expression_3,
    iterations=iterations)  # -> out, plant_radius, plant_heights, plant_output_state, plant_color
# ---------- c_script: C# ----------
    KdTreeNode<float, Plant> tree_node;
    List<float> xPos = (List<float>) xpositions;
    List<float> yPos = (List<float>) ypositions;
    List<int> pl_states = (List<int>) plant_states;
    List<int> pl_type = (List<int>) plant_type;
    int iter = Convert.ToInt32(iterations);
    List<float> pl_radius = (List<float>) plant_radius;
    List<float> pl_heights = (List<float>) plant_heights;
    List<float> pl_output_state = (List<float>) plant_output_state;
    List<float> pl_color = (List<float>) plant_color;

    for (int i = 0; i < xPos.Count; ++i)
    {
      switch (pl_type[i])
      {
        case (int) plant_enum.BEAR:
          tree_node = new KdTreeNode<float, Plant>(new float[] { xPos[i], yPos[i] }, new BearGrass(xPos[i], yPos[i], pl_states[i]));
          break;
        case (int) plant_enum.YUCCA:
          tree_node = new KdTreeNode<float, Plant>(new float[] { xPos[i], yPos[i] }, new Yucca(xPos[i], yPos[i], pl_states[i]));
          break;
        default:
          tree_node = new KdTreeNode<float, Plant>(new float[] { xPos[i], yPos[i] }, new LittleBluestem(xPos[i], yPos[i], pl_states[i]));
          break;
      }
      GrowthSimulation.simulation_plants.Add(tree_node);
      GrowthSimulation.plants_tree.Add(tree_node.Point, tree_node.Value);
    }

    //maybe this loop should go in grasshopper script, so C# script is run multiple times giving new output every time?
    for(int i = 0; i < iter; ++i)
    {
      ++month;
      GenerateChanges();
      ApplyChanges();
    }

    //modify variable plant_output_state
    foreach (var plant_node in simulation_plants) {
      pl_heights.Add(plant_node.Value.get_height());
      pl_radius.Add(plant_node.Value.get_width_radius());
      pl_output_state.Add(plant_node.Value.get_state());
      pl_color.Add(plant_node.Value.get_color_rep());
    }

    plant_heights = pl_heights;
    plant_radius = pl_radius;
    plant_output_state = pl_output_state;
    plant_color = pl_color;
# ---------- c_script: C# additional code ----------
  enum month_enum
  {
    JAN,
    FEB,
    MAR,
    APR,
    MAY,
    JUN,
    JUL,
    AUG,
    SEP,
    OCT,
    NOV,
    DEC
  }
  enum state_enum
  {
    ALIVE,
    SEED,
    DEAD
  }
  enum color_rep_enum
  {
    WINTER,
    FLOWER,
    GREEN
  }
  enum sun_enum
  {
    SHADE,
    PARTIAL,
    FULL
  }
  enum plant_enum
  {
    BEAR,
    YUCCA,
    BLUESTEM
  }
  abstract class Plant
  {
    protected float x, y, width_radius, height;
    protected int age;
    public state_enum state;
    protected const float min_radius = 99999;
    protected const sun_enum sun_requirements = sun_enum.FULL;
    public const int MaxNeighbors = 10;
    public static float AverageAustinSunAngleFactor = (float) Math.Atan(25.9);
    public const float MaxSunOverlap = 88; // Inches of max shadow based on beargrass (largest plant)
    public static float HeightToWidthRatio;

    public Plant(float x, float y, int state)
    {
      this.x = x;
      this.y = y;
      this.state = (state_enum) state;
      if (state == (int) state_enum.SEED)
      {
        this.width_radius = 0;
        this.height = 0;
        this.age = 0;
      }
      else
      {
        this.height = 4.33f; // Useless
        this.width_radius = 4; // Useless
        this.age = 5;
      }
    }

    //getters

    public abstract color_rep_enum get_color_rep();

    public virtual float SunRequirementsPercentage()
    {
      return 33; // Partial and Full Sun
    }

    public float get_height()
    {
      return this.height;
    }

    public float get_width_radius()
    {
      return this.width_radius;
    }

    public state_enum get_state() {
      return state;
    }

    public void NewDimensions(float new_height, float new_radius, state_enum new_state)
    {
      this.height = new_height;
      this.width_radius = new_radius;
      this.state = new_state;
    }

    public float ShadowLength()
    {
      return width_radius + (height * Plant.AverageAustinSunAngleFactor);
    }

    public float DistanceSquared(Plant neighbor)
    {
      return (float) (Math.Pow(x - neighbor.x, 2) + Math.Pow(y - neighbor.y, 2));
    }

    public float GetSunScaler()
    {
      var neighbors = GrowthSimulation.plants_tree.RadialSearch(new float[] { this.x, this.y }, Plant.MaxSunOverlap, Plant.MaxNeighbors);
      float shadow_percentage = 0;
      foreach (var neighbor in neighbors)
      {
        var shadow_length = neighbor.Value.ShadowLength();
        var distance_squared = this.DistanceSquared(neighbor.Value);
        if (distance_squared < this.MinSpace * this.MinSpace) {
          return -1;
        }
        if (neighbor.Value != this && distance_squared < (shadow_length * shadow_length))
        {
          shadow_percentage += (float) Math.Sqrt(distance_squared);
        }
      }
      shadow_percentage = Math.Min(shadow_percentage, width_radius) / width_radius;
      if(shadow_percentage < this.SunRequirementsPercentage())
      {
        return -1; // Magic Value -1 means plant died
      }
      return (float) ((0.217147241) * Math.Log(shadow_percentage + 1)); // http://www.solarpaneltilt.com/
    }

    public abstract float GetGrowth();

    public Changes simulate()
    {
      Changes changes;
      var total_growth = this.GetGrowth();
      if (total_growth == -1) {
        changes = new Changes(this, 0, 0, state_enum.Dead);
      } else
      {
        changes = new Changes(this, Math.Min(total_growth * (1 - this.HeightToWidthRatio), this.MaxHeight), Math.Min(total_growth * this.HeightToWidthRatio, this.MaxWidth));
      }
      ++this.age;
      return changes;
    }
  }

  class BearGrass : Plant
  {
    public static float minimum_radius = 18;
    public static float MaxHeight = 72;
    public static float MaxWidth = 30;
    public static new float HeightToWidthRatio = 0.41666664;
    public static new int bloom_years = 5;
    public BearGrass(float x, float y, int state) : base(x, y, state)
    {
      this.height = 4.365827924 * Math.Log(age * 4 + 4) - 6.901722353;
      this.width_radius = this.height * this.HeightToWidthRatio;
    }

    public override color_rep_enum get_color_rep()
    {
      switch (GrowthSimulation.month)
      {
        case month_enum.JAN:
          expected_color = color_rep_enum.WINTER;
        case month_enum.FEB:
          expected_color = color_rep_enum.WINTER;
        case month_enum.MAR:
          expected_color = color_rep_enum.FLOWER;
        case month_enum.APR:
          expected_color = color_rep_enum.FLOWER;
        case month_enum.MAY:
          expected_color = color_rep_enum.FLOWER;
        case month_enum.JUN:
          expected_color = color_rep_enum.FLOWER;
        case month_enum.JUL:
          expected_color = color_rep_enum.FLOWER;
        case month_enum.AUG:
          expected_color = color_rep_enum.GREEN;
        case month_enum.SEP:
          expected_color = color_rep_enum.GREEN;
        case month_enum.OCT:
          expected_color = color_rep_enum.GREEN;
        case month_enum.NOV:
          expected_color = color_rep_enum.WINTER;
        case month_enum.DEC:
          expected_color = color_rep_enum.WINTER;
      }
      if(expected_color == color_rep_enum.FLOWER && GrowthSimulation.GetYear() % bloom_years != 0) {
        return color_rep_enum.GREEN;
      }
      return color_rep_enum.WINTER;
    }

    public override float SunRequirementsPercentage()
    {
      return 66; // Full Sun Only
    }

    public override float GetGrowth()
    {
      float sun_scaler = this.GetSunScaler();
      if(sun_scaler == -1) return -1;
      return Math.Max((4.365827924 * Math.Log(age * 4 + 4) - 6.901722353) * this.GetSunScaler(), 0);
    }
  }

  class LittleBluestem : Plant
  {
    public static float minimum_radius = 4;
    public static float MaxHeight = 48;
    public static float MaxWidth = 18;
    public static new float HeightToWidthRatio = 0.25;
    public LittleBluestem(float x, float y, int state) : base(x, y, state)
    {
      this.height = 8.336309999 * Math.Log(age * 4 + 4) - 11.55657954;
      this.width_radius = this.height * this.HeightToWidthRatio;
    }

    public override color_rep_enum get_color_rep()
    {
      color_rep_enum expected_color;
      switch (GrowthSimulation.month)
      {
        case month_enum.JAN:
          return color_rep_enum.WINTER;
        case month_enum.FEB:
          return color_rep_enum.WINTER;
        case month_enum.MAR:
          return color_rep_enum.WINTER;
        case month_enum.APR:
          return color_rep_enum.GREEN;
        case month_enum.MAY:
          return color_rep_enum.GREEN;
        case month_enum.JUN:
          return color_rep_enum.FLOWER;
        case month_enum.JUL:
          return color_rep_enum.FLOWER;
        case month_enum.AUG:
          return color_rep_enum.FLOWER;
        case month_enum.SEP:
          return color_rep_enum.FLOWER;
        case month_enum.OCT:
          return color_rep_enum.FLOWER;
        case month_enum.NOV:
          return color_rep_enum.FLOWER;
        case month_enum.DEC:
          return color_rep_enum.FLOWER;
      }
      return color_rep_enum.WINTER;
    }

    public override float GetGrowth()
    {
      float sun_scaler = this.GetSunScaler();
      if(sun_scaler == -1) return -1;
      return (4.365827924 * Math.Log(age) - 2.901722353) * this.GetSunScaler();
    }
  }

  class Yucca : Plant
  {
    public static float minimum_radius = 4;
    public static float MaxHeight = 48;
    public static float MaxWidth = 12;
    public static new float HeightToWidthRatio = 0.375;
    public Yucca(float x, float y, int state) : base(x, y, state)
    {
      this.height = 5.683847725 * Math.Log(age * 4 + 4) - 7.879486051;
      this.width_radius = this.height * this.HeightToWidthRatio;
    }

    public override color_rep_enum get_color_rep()
    {
      switch (GrowthSimulation.month)
      {
        case month_enum.JAN:
          return color_rep_enum.WINTER;
        case month_enum.FEB:
          return color_rep_enum.WINTER;
        case month_enum.MAR:
          return color_rep_enum.FLOWER;
        case month_enum.APR:
          return color_rep_enum.FLOWER;
        case month_enum.MAY:
          return color_rep_enum.FLOWER;
        case month_enum.JUN:
          return color_rep_enum.FLOWER;
        case month_enum.JUL:
          return color_rep_enum.FLOWER;
        case month_enum.AUG:
          return color_rep_enum.GREEN;
        case month_enum.SEP:
          return color_rep_enum.GREEN;
        case month_enum.OCT:
          return color_rep_enum.GREEN;
        case month_enum.NOV:
          return color_rep_enum.WINTER;
        case month_enum.DEC:
          return color_rep_enum.WINTER;
      }
      return color_rep_enum.WINTER;
    }

    public override float GetGrowth()
    {
      float sun_scaler = this.GetSunScaler();
      if(sun_scaler == -1) return -1;
      return (4.365827924 * Math.Log(age + 4) - 2.901722353) * this.GetSunScaler();
    }
  }
  class Changes
  {
    private Plant changer;
    private float new_height;
    private float new_radius;
    private state_enum new_state;

    public Changes(Plant plant, float nheight, float nradius, state_enum nstate)
    {
      changer = plant;
      new_height = nheight;
      new_radius = nradius;
      new_state = nstate;
    }
    public void ApplyChanges()
    {
      changer.NewDimensions(new_height, new_radius, new_state);
    }
  }

  class GrowthSimulation
  {
    private static int month;
    public static List<KdTreeNode<float, Plant>> simulation_plants;
    public static KdTree<float, Plant> plants_tree;
    private static Queue<Changes> changes_queue;

    private static void GenerateChanges()
    {
      foreach (var plant_node in simulation_plants)
      {
        changes_queue.Enqueue(plant_node.Value.simulate());
      }
    }

    private static void ApplyChanges()
    {
      while(changes_queue.Any())
      {
        var head = changes_queue.Dequeue();
        head.ApplyChanges();
      }
    }

    public static int get_month()
    {
      return (int) GrowthSimulation.month;
    }

    public static int GetYear()
    {
      return (int) (GrowthSimulation.month / 12);
    }
  }
# ---------- end c_script ----------
random_4 = Random(Range="(18,32)", Number=lng, Seed=Slider(0.25, range=0..1))
random_5 = Random(Range="(0,2.999999)", Number=lng, Seed=Slider(3.857, range=0..5))

# ----
# Red Yucca
swatch = ColourSwatch(SwatchColor=RGB(125, 143, 77))
panel_6 = Panel([ColourSwatch(SwatchColor=RGB(125, 143, 77)), ColourSwatch(SwatchColor=RGB(194, 78, 118)), swatch])

# ----
# Little Bluestem
swatch_2 = ColourSwatch(SwatchColor=RGB(194, 2, 34))
panel_7 = Panel([ColourSwatch(SwatchColor=RGB(144, 165, 166)), swatch_2, ColourSwatch(SwatchColor=RGB(135, 88, 68))])

# ----
# Bear Grass
swatch_3 = ColourSwatch(SwatchColor=RGB(144, 163, 65))
panel_8 = Panel([swatch_3, ColourSwatch(SwatchColor=RGB(187, 191, 168)), ColourSwatch(SwatchColor=RGB(144, 163, 65))])

expression_6 = Expression(p=pt, y=random_4, Expression="p.z+y")
expression_7 = Expression(x=random_5, Expression="int(x)")
panel_9 = Panel(expression_7)
panel_10 = Panel(ColourSwatch(SwatchColor=RGB(0, 0, 0)))
random_6 = Random(Range="(4,30)", Number=lng, Seed=Slider(0.25, range=0..1))
cir = Circle(Plane=pt, Radius=random_6)
Z = UnitZ(Factor=expression_6)
boundary = BoundarySurfaces(Edges=cir)
c_script_2 = CSharpScript(
    options_bear_grass=panel_8,
    options_blue_stem=panel_7,
    options_yucca=panel_6,
    plant_type=expression_3,
    selected_seasons=panel_5,
    death_color=panel_10,
    plant_states=panel_9)  # -> out, selected_colors; inputs options_bear_grass: list of String, options_blue_stem: list of String, options_yucca: list of String, plant_type: list of Int32, selected_seasons: list of Int32, death_color: String, plant_states: list of Int32
# ---------- c_script_2: C# ----------
    List<string> chosen_colors = new List<string>();

    for (int i = 0; i < plant_type.Count; i++) {
      if (plant_states[i] == 2) {
         chosen_colors.Add(death_color);
      } else {
        switch(plant_type[i]){
          case 0:
            chosen_colors.Add(options_bear_grass[selected_seasons[i]]);
            break;
          case 1:
            chosen_colors.Add(options_yucca[selected_seasons[i]]);
            break;
          default:
            chosen_colors.Add(options_blue_stem[selected_seasons[i]]);
            break;
        }
      }
    }
    selected_colors = chosen_colors;
# ---------- end c_script_2 ----------
extr = Extrude(Base=boundary, Direction=Z)
cap = CapHoles(Brep=extr)
panel_11 = Panel(c_script_2.selected_colors)
preview = CustomPreview(Geometry=cap, Shader=panel_11)
