# Grasshopper definition exo coloring2.gh (Grasshopper 0.9.76)
# plug-ins: MarchingCubes, Python Interpreter, Anemone, Kangaroo Components, Weaverbird

size = Slider(100, range=0..100)

# ---- group: Settings / World
size_2 = Slider(40, range=0..100)
box = DomainBox(Base=PlaneXY(0, 0, 0), X=size_2, Y=size_2, Z=size)
wires = BrepWireframe(Brep=box, Density=-1)

# ---- group: Settings
number = Slider(249, range=0..300)
pop3d = Populate3D(Region=box, Count=number, Seed=1)

# ---- group: Settings / Random vectors
random = Random(Range="-1 to 1", Number=number, Seed=Slider(292, range=0..1000))
random_2 = Random(Range="-1 to 1", Number=number, Seed=Slider(456, range=0..1000))
random_3 = Random(Range="-1 to 1", Number=number, Seed=Slider(789, range=0..1000))
vec = VectorXYZ(XComponent=random, YComponent=random_2, ZComponent=random_3)  # -> Vector, Length

# ----
cohesion = Slider(4.2389, range=0..5)
number_slider = Slider(0, range=0..10)
number_slider_2 = Slider(24.144, range=0..50)
separation = Slider(1.4937, range=0..2)
alignment = Slider(1.6305, range=0..4)
number_slider_3 = Slider(1.038, range=0..10)
number_slider_4 = Slider(4.036, range=0..10)

# ---- group: Settings
repeats = Slider(145, range=0..1000)
separation_2 = ConstructDomain(DomainStart=number_slider, DomainEnd=number_slider_3)
alignment_2 = ConstructDomain(DomainStart=number_slider_3, DomainEnd=number_slider_4)
cohesion_2 = ConstructDomain(DomainStart=number_slider_4, DomainEnd=number_slider_2)

# ----
loop_start = LoopStart(
    Repeat=repeats,
    Trigger=[separation, alignment, cohesion, number_slider, number_slider_3, number_slider_4, number_slider_2],
    Data_0=pop3d,
    Data_1=vec.Vector)  # -> port, Counter, Data_0, Data_1
int = Integer(8)
prox = Proximity3D(Points=loop_start.Data_0, Group=int, MinRadius=number_slider, MaxRadius=number_slider_2)  # -> Links, Topology
len = Length(Curve=prox.Links)
inc = Includes(Value=len, Domain=separation_2)  # -> Includes, Deviation
inc_2 = Includes(Value=len, Domain=alignment_2)  # -> Includes, Deviation
inc_3 = Includes(Value=len, Domain=cohesion_2)  # -> Includes, Deviation
cull = CullPattern(List=prox.Topology, CullPattern=inc.Includes)
cull_2 = CullPattern(List=prox.Topology, CullPattern=inc_3.Includes)
cull_3 = CullPattern(List=prox.Topology, CullPattern=inc_2.Includes)
item = ListItem(List=loop_start.Data_0, Index=cull, Wrap=False)
item_2 = ListItem(List=loop_start.Data_1, Index=cull_3, Wrap=False)
item_3 = ListItem(List=loop_start.Data_0, Index=cull_2, Wrap=False)
avr = Average(Input=item)  # -> flatten(ArithmeticMean)
avr_2 = Average(Input=item_3)  # -> flatten(ArithmeticMean)
vec2pt = Vector2Pt(PointA=avr, PointB=loop_start.Data_0, Unitize=False)  # -> Vector, Length
vec2pt_2 = Vector2Pt(PointA=loop_start.Data_0, PointB=avr_2, Unitize=True)  # -> Vector, Length
null = NullItem(Item=vec2pt.Vector)  # -> NullFlags, InvalidFlags, Description
null_2 = NullItem(Item=vec2pt_2.Vector)  # -> NullFlags, InvalidFlags, Description
ma = MassAddition(Input=null.NullFlags)  # -> Result, PartialResults
ma_2 = MassAddition(Input=null_2.NullFlags)  # -> Result, PartialResults
vec_0_0_0 = Vector(Vector(0, 0, 0))
lng = ListLength(List=ma.Result)
lng_2 = ListLength(List=ma_2.Result)
dup = DuplicateData(Data=vec_0_0_0, Number=lng, Order=True)
dup_2 = DuplicateData(Data=vec_0_0_0, Number=lng_2, Order=True)
nullrep = ReplaceNulls(Items=vec2pt.Vector, Replacements=dup)  # -> Items, Count
nullrep_2 = ReplaceNulls(Items=vec2pt_2.Vector, Replacements=dup_2)  # -> Items, Count
vlen = VectorLength(Vector=nullrep.Items)
vlen_2 = VectorLength(Vector=nullrep_2.Items)
expression = Expression(x=vlen, Expression="if(x=0,1000,x)")
avr_3 = Average(Input=item_2)  # -> simplify(graft(ArithmeticMean))
expression_2 = Expression(x=vlen_2, Expression="if(x=0,1000,x)")
unit = UnitVector(Vector=avr_3)
one_over_x = OneOverX(Value=expression)
multiplication = Multiplication(A=nullrep_2.Items, B=expression_2)
multiplication_2 = Multiplication(A=nullrep.Items, B=one_over_x)
multiplication_3 = Multiplication(A=multiplication_2, B=separation)  # -> simplify(graft(Result))
multiplication_4 = Multiplication(A=unit, B=alignment)  # -> simplify(graft(Result))
multiplication_5 = Multiplication(A=multiplication, B=cohesion)  # -> simplify(graft(Result))
merge = Merge(Data1=multiplication_3, Data2=multiplication_4, Data3=multiplication_5)
avr_4 = Average(Input=merge)  # -> flatten(ArithmeticMean)
move = Move(Geometry=loop_start.Data_0, Motion=avr_4)  # -> Geometry, Transform
pdecon = Deconstruct(Point=move.Geometry)  # -> XComponent, YComponent, ZComponent
num = Number(0)
num_2 = Number(size_2)
num_3 = Number(0)
num_4 = Number(size)
num_5 = Number(size_2)
num_6 = Number(0)
expression_3 = Expression(x=pdecon.YComponent, y=num_3, z=num_5, Expression="if(x<0,z,if(x>z,0,x))")
expression_4 = Expression(x=pdecon.ZComponent, y=num_6, z=num_4, Expression="if(x<0,z,if(x>z,0,x))")
expression_5 = Expression(x=pdecon.XComponent, y=num, z=num_2, Expression="if(x<0,z,if(x>z,0,x))")
pt = ConstructPoint(XCoordinate=expression_5, YCoordinate=expression_3, ZCoordinate=expression_4)
unit_2 = UnitVector(Vector=avr_4)
loop_end = LoopEnd(port=loop_start.port, Exit=False, Data_0=flatten(pt), Data_1=flatten(avr_4), pausedState=False, state="Constant output")  # -> Data_0, Data_1
vdisex = VectorDisplayEx(Point=pt, Vector=unit_2, Colour=RGB(0, 0, 0), Width=2)

number_slider_5 = Slider(0.604, range=0..1)
python = PythonScript(x=pt)  # -> out, a; inputs x: list; disabled
# ---------- python: Python ----------
import rhinoscriptsyntax as rs
a = []
x0 = x.pop()
while x:
    x1 = rs.PointArrayClosestPoint(x, x0)
    x1_p = x.pop(x1)
    a.append(rs.AddLine(x0, x1_p))
    x0 = x1_p
# ---------- end python ----------
curve_charge = CurveCharge(Curve=python.a, Radius=Slider(8.917, range=0..10), ChargeStrengths=number_slider_5)
point_charge = PointCharge(Point=pt, Radius=Slider(14.917, range=0..30), ChargeStrength=number_slider_5)
merge_2 = Merge(Data1=curve_charge, Data2=point_charge)
cocoon = Cocoon(Charges=merge_2, Iso=Slider(0.063, range=0..1), CellSize=Slider(1, range=0..1), Execute=Toggle(True), Simple=False)  # -> Mesh, RefinementData; disabled
pt_2 = Point(Point(1000, 1000, 0))
munion = MeshUnion(Meshes=flatten(cocoon.Mesh))
rec_2pt = Rectangle2Pt(Plane=PlaneXY(0, 0, 0), PointA=Point(0, 0, 0), PointB=pt_2, Radius=0)  # -> Rectangle, Length
weld = WeldMesh(Mesh=munion, Angle=Slider(23.321, range=0..90))
boxrec = BoxRectangle(Rectangle=rec_2pt.Rectangle, Height=Slider(-39, range=-100..0))
c_script = CSharpScript(M=weld, P="99.5")  # -> out, A; inputs M: Mesh, P: Double; disabled
# ---------- c_script: C# ----------
    if(M != null){
      Guid meshObj = doc.Objects.AddMesh(M);
      doc.Objects.UnselectAll();
      doc.Objects.Select(meshObj);
      Rhino.RhinoApp.RunScript("_-ReduceMesh _ReductionPercentage " + Convert.ToString(P) + " _Enter", false);
      Rhino.DocObjects.RhinoObject MObj = doc.Objects.GetSelectedObjects(false, false).First();
      doc.Objects.Delete(meshObj, true);
      A = MObj.Geometry;
    }
# ---------- end c_script ----------
msphere = MeshSphere(Base=PlaneXY(0, 0, 0), Radius=10, UCount=10, VCount=20)
mbox = MeshBox(Base=boxrec, XCount=10, YCount=10, ZCount=10)
mdif = MeshDifference(MeshesA=c_script.A, MeshesB=mbox)
weight = Slider(0.018, range=0..1)
medges = MeshEdges(Mesh=msphere)  # -> NakedEdges, InteriorEdges, NonManifoldEdges
python_2 = PythonScript(x=medges.InteriorEdges)  # -> out, a; inputs x: list
# ---------- python_2: Python ----------
a = [1 for j in range(0, len(x))]
# ---------- end python_2 ----------
neg = Negative(Value=weight)
end = EndPoints(Curve=graft(medges.InteriorEdges))  # -> Start, End
len_2 = Length(Curve=medges.InteriorEdges)
loop_start_2 = LoopStart(Repeat=Slider(4, range=0..5), Data=python_2.a)  # -> port, Counter, Data
Z = UnitZ(Factor=neg)
demesh = DeconstructMesh(Mesh=msphere)  # -> Vertices, Faces, Colours, Normals
multiplication_6 = Multiplication(A=len_2, B=Z)
uforce = UnaryForce(Point=[end.Start, end.End], Force=multiplication_6)
panel = Panel(loop_start_2.Data)
python_3 = PythonScript(x=demesh.Vertices)  # -> out, a; inputs x: list of Point3d
# ---------- python_3: Python ----------
a = []
for pnt in x:
    if pnt[2] < -9.999:
        a.append(pnt)
# ---------- end python_3 ----------
vec_2 = Vector(python_3.a)
entwine = Entwine(Branch00=medges.InteriorEdges, Branch01=python_3.a, Branch02=vec_2, FlattenInputs=True)
springs = SpringsFromLine(
    Connection=medges.InteriorEdges,
    Stiffness=panel,
    Damping=10,
    RestLength=medges.InteriorEdges,
    UpperCutoff=0,
    LowerCutoff=0,
    Plasticity=0)
kangaroo = KangarooPhysics(
    ForceObjects=flatten([springs, uforce]),
    AnchorPoints=python_3.a,
    Settings=null,
    Geometry=entwine,
    SimulationReset=Toggle(False))  # -> Out, Iterations, ParticlesOut, GeometryOut, KE
kangaroo_settings = KangarooSettings(
    Tolerance=0.01,
    TimeStep=0.01,
    SubIterations=10,
    Floor=False,
    Drag=1,
    Restitution=0.7,
    StaticFriction=10,
    KineticFriction=10,
    Settle=2,
    Tumble=1,
    Sound=False,
    Solver=0)
bang = ExplodeTree(Data=kangaroo.GeometryOut)  # -> Branch0, Branch1, Branch2
len_3 = Length(Curve=bang.Branch0)
len_4 = Length(Curve=medges.InteriorEdges)
subtraction = Subtraction(A=len_3, B=len_4)
neg_2 = Negative(Value=".02")
python_4 = PythonScript(delta=subtraction, length=len_4)  # -> out, a; inputs delta: list, length: list
# ---------- python_4: Python ----------
import math
a = list()
for i in range(0, len(delta)):
    c = 1 + abs(delta[i])
    c = c #  ** 25
    k = c / length[i]+1
    a.append(.2*k)
# ---------- end python_4 ----------
gradient = Gradient(
    LowerLimit=neg_2,
    UpperLimit=".02",
    Parameter=subtraction,
    stops=[0: RGB(255, 0, 0), 0.295: RGB(255, 255, 0), 0.501: RGB(0, 255, 0), 0.705: RGB(255, 255, 0), 1: RGB(220, 0, 40)])
buffer = TimeBuffer(Data=python_4.a, Ms=Slider(1000, range=0..1000), UseThread=True)
panel_2 = Panel(python_4.a)
loop_paused = LoopPaused(port=loop_start_2.port, Exit=False, Data=flatten(buffer), pausedState=True, state="Output last", TimeOutVal=0)
preview = CustomPreview(Geometry=bang.Branch0, Shader=gradient)
pipe = Pipe(Curve=medges.InteriorEdges, Radius=python_4.a, Caps="1")  # disabled
sunion = SolidUnion(Breps=pipe)
wbjoin = WeaverbirdsJoinMeshesAndWeld(Mesh=pipe, Weld=False)
weld_2 = WeldMesh(Mesh=flatten(pipe), Angle=3.141592654)
wbunify = WeaverbirdsUnifyFaceWindings(MeshCurves=wbjoin)
wbnaked = WeaverbirdsNakedBoundary(MeshClosedPolylines=wbjoin)
